# Grasshopper definition 00_DrawViewportWiresMeshes.gh (Grasshopper 1.0.7)

# ---- group: Draw Flat Shaded Two-Sided Mesh with Custom Wire Thickness/Color
mesh = Mesh(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)
dmf = DrawMeshFlat(
    Mesh=mesh,
    FrontColor=ColourSwatch(SwatchColor=RGB(235, 235, 235)),
    BackColor=ColourSwatch(SwatchColor=RGB(255, 127, 0)),
    EdgeColor=ColourSwatch(SwatchColor=RGB(0, 0, 0)),
    EdgeWidth=Slider(1, range=0..10))
# ---------- dmf: Python ----------
import Rhino as rc
import GhPython.Assemblies.ExecutingComponent as component
from System.Drawing import Color

class MyComponent(component):
    
    def RunScript(self,Mesh,FrontColor,BackColor,EdgeColor,EdgeWidth):
            
            # Assign input parameters
            self.mesh = Mesh
            self.edgeColor = EdgeColor
            self.edgeWidth = EdgeWidth
            
            # Set front/back colors
            self.material = rc.Display.DisplayMaterial(Color.Black)
            self.material.Emission = FrontColor
            if BackColor:
                self.material.IsTwoSided = True
                self.material.BackDiffuse = Color.Black
                self.material.BackEmission = BackColor
                
    def DrawViewportMeshes(self,arg):
        arg.Display.DrawMeshShaded(self.mesh,self.material)
        
    def DrawViewportWires(self,arg):
        arg.Display.DrawMeshWires(self.mesh,self.edgeColor,self.edgeWidth)
# ---------- end dmf ----------

# ---- group: Draw 2D Text in Screen Space
panel = Panel("""Ham:
- Foo
- Bar
- Jeff
- Britta
- 100%""")
pt = Point(Point(100, 100, 0))
dst = DrawScreenText(Text=panel, Color=ColourSwatch(SwatchColor=RGB(0, 177, 81)), Height=Slider(28, range=0..30), Point=pt, Font="Consolas")
# ---------- dst: Python ----------
import Rhino as rc
import GhPython.Assemblies.ExecutingComponent as component

class MyComponent(component):
    
    def RunScript(self,Text,Color,Height,Point,Font):
        
        # Assign input parameters
        self.text = Text
        self.color = Color
        self.height = Height
        self.point = rc.Geometry.Point2d(Point.X,Point.Y)
        self.font = Font
        
    def DrawViewportWires(self,arg):
        
        """ Call DrawViewportWires method """
        
        # Draw 2D text
        arg.Display.Draw2dText(self.text,self.color,
        self.point,False,self.height,self.font)
# ---------- end dst ----------

# ---- group: Draw Curves with Custom Weights
thickness = Slider(15, range=0..20)
crv = Curve([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])
dc = DrawCurves(Curves=crv, Weight=thickness, Color=ColourSwatch(SwatchColor=RGB(0, 166, 255)))  # inputs Curves: list
#   port Curves: Curves to render {list,curve}
# ---------- dc: Python ----------
import Rhino as rc
import GhPython.Assemblies.ExecutingComponent as component

class MyComponent(component):
    
    def RunScript(self,Curves,Weight,Color):
        
        # Assign input parameters
        self.curves = Curves
        self.weight = Weight
        self.color = Color
        
    def DrawViewportWires(self,arg):
        
        """ Call DrawViewportWires method """
        
        # Draw curves in loop
        for crv in self.curves:
            arg.Display.DrawCurve(crv,self.color,self.weight)
# ---------- end dc ----------
