# Grasshopper definition 01_DrawForegroundDesignPattern.gh (Grasshopper 1.0.7)
# Copyright: Liljewall Arkitekter

python = GhPythonScript(Text="Ham", Color=ColourSwatch(SwatchColor=RGB(255, 225, 0)))
# ---------- python: Python ----------
import System
import Rhino as rc
import Grasshopper as gh
import GhPython.Assemblies.ExecutingComponent as component

class MyComponent(component):
        
    def RunScript(self,Text,Color):
        rc.RhinoApp.WriteLine("A 2")
        
        # Assign input variables
        self.txt = Text
        self.col = Color
        self.black = System.Drawing.Color.Black
        
    def DrawForeground(self,sender,arg):
        rc.RhinoApp.WriteLine("A 3")
        
        # Check component preview/locked, active GH document and Rhino viewport
        if (not ghenv.Component.Hidden and not ghenv.Component.Locked 
            and ghenv.Component.OnPingDocument() == gh.Instances.ActiveCanvas.Document
            and arg.Viewport.Id == arg.RhinoDoc.ActiveDoc.Views.ActiveView.ActiveViewportID):
            
            rc.RhinoApp.WriteLine("A 4")
            
            # Text is drawn in front of mesh
            pt = rc.Geometry.Point2d(180,100)
            arg.Display.Draw2dText(self.txt,self.black,pt,False,100,"Consolas")
            
            # Rectangle is drawn in front of mesh
            rec2d = System.Drawing.Rectangle(50,100,100,100)
            arg.Display.Draw2dRectangle(rec2d,self.black,10,self.col)
            
    def __enter__(self):
        rc.RhinoApp.WriteLine("A 1")
        rc.Display.DisplayPipeline.DrawForeground += self.DrawForeground
        
    def __exit__(self):
        rc.RhinoApp.WriteLine("A 5")
        rc.Display.DisplayPipeline.DrawForeground -= self.DrawForeground
# ---------- end python ----------

python_2 = GhPythonScript(Text="Spam", Color=ColourSwatch(SwatchColor=RGB(48, 169, 255)))
# ---------- python_2: Python ----------
import System
import Rhino as rc
import Grasshopper as gh
import GhPython.Assemblies.ExecutingComponent as component

class MyComponent(component):
    
    def RunScript(self,Text,Color):
        
        # Assign input variables
        self.txt = Text
        self.col = Color
        self.black = System.Drawing.Color.Black
        
    def DrawForeground(self,sender,arg):
        
        # Check component preview/locked, active GH document and Rhino viewport
        if (not ghenv.Component.Hidden and not ghenv.Component.Locked
            and ghenv.Component.OnPingDocument() == gh.Instances.ActiveCanvas.Document
            and arg.Viewport.Id == arg.RhinoDoc.ActiveDoc.Views.ActiveView.ActiveViewportID):
            
            # Text is drawn in front of mesh
            pt = rc.Geometry.Point2d(180,300)
            arg.Display.Draw2dText(self.txt,self.black,pt,False,100,"Consolas")
            
            # Rectangle is drawn in front of mesh
            rec2d = System.Drawing.Rectangle(50,300,100,100)
            arg.Display.Draw2dRectangle(rec2d,self.black,10,self.col)
            
    def __enter__(self):
        rc.Display.DisplayPipeline.DrawForeground += self.DrawForeground
        
    def __exit__(self):
        rc.Display.DisplayPipeline.DrawForeground -= self.DrawForeground
# ---------- end python_2 ----------

python_3 = GhPythonScript(Text="Eggs", Color=ColourSwatch(SwatchColor=RGB(255, 155, 48)))
# ---------- python_3: Python ----------
import System
import Rhino as rc
import Grasshopper as gh
import GhPython.Assemblies.ExecutingComponent as component

class MyComponent(component):
    
    def RunScript(self,Text,Color):
        
        # Assign input variables
        self.txt = Text
        self.col = Color
        self.black = System.Drawing.Color.Black
        
    def DrawForeground(self,sender,arg):
        
        # Check component preview/locked, active GH document and Rhino viewport
        if (not ghenv.Component.Hidden and not ghenv.Component.Locked
            and ghenv.Component.OnPingDocument() == gh.Instances.ActiveCanvas.Document
            and arg.Viewport.Id == arg.RhinoDoc.ActiveDoc.Views.ActiveView.ActiveViewportID):
            
            # Text is drawn in front of mesh
            pt = rc.Geometry.Point2d(180,500)
            arg.Display.Draw2dText(self.txt,self.black,pt,False,100,"Consolas")
            
            # Rectangle is drawn in front of mesh
            rec2d = System.Drawing.Rectangle(50,500,100,100)
            arg.Display.Draw2dRectangle(rec2d,self.black,10,self.col)
            
    def __enter__(self):
        rc.Display.DisplayPipeline.DrawForeground += self.DrawForeground
        
    def __exit__(self):
        rc.Display.DisplayPipeline.DrawForeground -= self.DrawForeground
# ---------- end python_3 ----------

# ---- group: Obscure with Mesh to Test
mbox = MeshBox(Base={Plane=PlaneXY(0, 0, 0), X=Domain(-10, 10), Y=Domain(-10, 10), Z=Domain(-10, 10)}, XCount=10, YCount=10, ZCount=10)
