# Grasshopper definition 02_DrawEmbeddedSpriteBitmap.gh (Grasshopper 1.0.7)
# Copyright: Liljewall Arkitekter

# ---- group: Draw Embedded Sprite/Bitmap
python = GhPythonScript(X=Slider(100, range=0..1000), Y=Slider(100, range=0..1000))
# ---------- python: Python ----------
import System
import Rhino as rc
import Grasshopper as gh
import GhPython.Assemblies.ExecutingComponent as component

class MyComponent(component):
        
    def RunScript(self,X,Y):
        self.pt = rc.Geometry.Point2d(X,Y)
        
    def DrawForeground(self,sender,arg):
        
        # Check component preview/locked, active GH document and Rhino viewport
        if (not ghenv.Component.Hidden and not ghenv.Component.Locked 
            and ghenv.Component.OnPingDocument() == gh.Instances.ActiveCanvas.Document
            and arg.Viewport.Id == arg.RhinoDoc.ActiveDoc.Views.ActiveView.ActiveViewportID):
            
            # Convert image encoded as byte string to .NET bitmap
            string = "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"
            byteArray = System.Convert.FromBase64String(string)
            bitmap1 = System.Drawing.ImageConverter().ConvertFrom(byteArray)
            
            # Convert to RhinoCommon bitmap and draw sprite
            bitmap2 = rc.Display.DisplayBitmap(bitmap1)
            arg.Display.DrawSprite(bitmap2,self.pt,64,64)
            
    def __exit__(self):
        rc.Display.DisplayPipeline.DrawForeground -= self.DrawForeground
        
    def __enter__(self):
        rc.Display.DisplayPipeline.DrawForeground += self.DrawForeground
# ---------- end python ----------

# ---- group: Obscure with Mesh to Test
mbox = MeshBox(Base={Plane=PlaneXY(0, 0, 0), X=Domain(-10, 10), Y=Domain(-10, 10), Z=Domain(-10, 10)}, XCount=10, YCount=10, ZCount=10)
