# Grasshopper definition 02_DrawEmbeddedSpriteBitmap_RightCornerOverLay.gh (Grasshopper 1.0.7)
# Copyright: Liljewall Arkitekter

# ---- group: Draw Embedded Sprite/Bitmap
python = GhPythonScript(Scale=Slider(0.79, range=0..10), Offset=Slider(10, range=0..100))
# ---------- python: Python ----------
import System
import Rhino as rc
import Grasshopper as gh
import GhPython.Assemblies.ExecutingComponent as component

class MyComponent(component):
        
    def RunScript(self,Scale,Offset):
        self.scale,self.offset = Scale,Offset
        
    def DrawOverlay(self,sender,arg):
        
        # Check component preview/locked, active GH document
        if (not ghenv.Component.Hidden and not ghenv.Component.Locked 
            and ghenv.Component.OnPingDocument() == gh.Instances.ActiveCanvas.Document):
            
            # Convert image encoded as byte string to .NET bitmap
            string = "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"
            byteArray = System.Convert.FromBase64String(string)
            bitmap1 = System.Drawing.ImageConverter().ConvertFrom(byteArray)
            
            # Make draw position point at right upper corner
            bmw = bitmap1.Width * self.scale
            bmh = bitmap1.Height * self.scale
            vpw = arg.Viewport.Size.Width
            pt = rc.Geometry.Point2d((vpw-bmw/2)-self.offset,(bmh/2)+self.offset)
            
            # Convert to RhinoCommon bitmap and draw sprite
            bitmap2 = rc.Display.DisplayBitmap(bitmap1)
            arg.Display.DrawSprite(bitmap2,pt,bmw,bmh)
            
    def __exit__(self):
        rc.Display.DisplayPipeline.DrawOverlay -= self.DrawOverlay
        
    def __enter__(self):
        rc.Display.DisplayPipeline.DrawOverlay += self.DrawOverlay
# ---------- end python ----------

# ---- group: Obscure with Mesh to Test
mbox = MeshBox(Base={Plane=PlaneXY(0, 0, 0), X=Domain(-10, 10), Y=Domain(-10, 10), Z=Domain(-10, 10)}, XCount=10, YCount=10, ZCount=10)
