# Grasshopper definition 09_MouseHoverOverState.gh (Grasshopper 1.0.7)
# Copyright: Liljewall Arkitekter

# ---- group: Draw Screen Swatch With Hover Over State
python = GhPythonScript(Text="Eggs", Color=ColourSwatch(SwatchColor=RGB(255, 208, 0)))
# ---------- python: Python ----------
import Rhino as rc
import Grasshopper as gh
import System.Drawing as sd
import GhPython.Assemblies.ExecutingComponent as component

class MyMouseCallback(rc.UI.MouseCallback):
    
    def __init__(self):
        self.move = None
        
    def OnMouseMove(self,arg):
        self.move = arg
        ghenv.Component.ExpireSolution(True)
        
    def OnMouseUp(self,arg):
        self.down = arg
        ghenv.Component.ExpireSolution(True)
        
class MyComponent(component):
    
    def RunScript(self,Text,Color):
        self.txt,self.c1,self.c2 = Text,Color,sd.Color.Black
        
    def DrawForeground(self,sender,arg):
        if (not ghenv.Component.Hidden and not ghenv.Component.Locked 
            and ghenv.Component.OnPingDocument() == gh.Instances.ActiveCanvas.Document
            and arg.Viewport.Id == arg.RhinoDoc.ActiveDoc.Views.ActiveView.ActiveViewportID):
            
            # Define rectangle to draw and get mouse position in viewport screen space
            rec = sd.Rectangle(50,100,100,100)
            mpt = rc.Geometry.Point2d(self.mouse.move.ViewportPoint.X,self.mouse.move.ViewportPoint.Y)
            
            # Check if mouse is inside rectangle and draw different stuff dependingly
            if rec.X + rec.Width > mpt.X > rec.X and rec.Y + rec.Height > mpt.Y > rec.Y:
                recPt = rc.Geometry.Point2d(rec.X + rec.Width+10,rec.Y)
                arg.Display.Draw2dRectangle(rec,self.c2,10,sd.Color.DodgerBlue)
                rc.RhinoApp.WriteLine(str(self.mouse.down.Button))
                
                if self.mouse.down.MouseButton == rc.UI.MouseButton.Left:
                    arg.Display.Draw2dText(self.txt,self.c2,mpt,False,25,"Consolas")
                    arg.Display.Draw2dText(str(mpt),self.c2,recPt,False,100,"Consolas")
            else:
                arg.Display.Draw2dRectangle(rec,self.c2,10,self.c1)
                
    def __enter__(self):
        rc.Display.DisplayPipeline.DrawForeground += self.DrawForeground
        self.mouse = MyMouseCallback()
        self.mouse.Enabled = True
        
    def __exit__(self):
        rc.Display.DisplayPipeline.DrawForeground -= self.DrawForeground
        self.mouse.Enabled = False
        del self.mouse
# ---------- end python ----------

# ---- group: Obscure with Mesh to Test
mbox = MeshBox(Base={Plane=PlaneXY(0, 0, 0), X=Domain(-10, 10), Y=Domain(-10, 10), Z=Domain(-10, 10)}, XCount=10, YCount=10, ZCount=10)
