# Grasshopper definition 11_GetClosestMeshUnderMouse.gh (Grasshopper 1.0.7)
# Copyright: Liljewall Arkitekter

number_slider = Slider(30, range=0..100)
pop3d = Populate3D(
    Region={Plane=PlaneXY(0, 0, 0), X=Domain(0, 100), Y=Domain(0, 100), Z=Domain(0, 10)},
    Count=Slider(1000, range=0..1000),
    Seed=1)
msphere = MeshSphere(Base=pop3d, Radius=Slider(1.8, range=0..10), UCount=number_slider, VCount=number_slider)

# ---- group: Get Closest Mesh Under Mouse
python = GhPythonScript(Meshes=msphere)  # -> Index, Mesh; inputs Meshes: list
# ---------- python: Python ----------
"""
Get closest mesh under mouse location.
Author: Anders Holden Deleuran
Version: 240706
"""

import Rhino as rc
import GhPython.Assemblies.ExecutingComponent as component

class MyMouseCallback(rc.UI.MouseCallback):
    
    def __init__(self):
        self.move = None
        
    def OnMouseMove(self,arg):
        self.move = arg
        ghenv.Component.ExpireSolution(True)

class MyComponent(component):
    
    def RunScript(self,Meshes):
        
        # Get mouse viewport position
        mpt = rc.RhinoDoc.ActiveDoc.Views.ActiveView.ScreenToClient(rc.UI.MouseCursor.Location)
        
        # Make ray along frustum line at mouse
        r,fl = rc.RhinoDoc.ActiveDoc.Views.ActiveView.ActiveViewport.GetFrustumLine(mpt.X,mpt.Y)
        ray = rc.Geometry.Ray3d(fl.From,fl.Direction)
        
        # Shot ray onto meshes
        hits = []
        for i,m in enumerate(Meshes):
            t = rc.Geometry.Intersect.Intersection.MeshRay(m,ray)
            if t >= 0.0:
                hits.append((t,i,m))
                
        # Get closest hit index/mesh and return those
        if hits:
            hits.sort(reverse=True)
            t,i,m = hits[0]
            return i,m
        else:
            return [],[]
            
    def __enter__(self):
        self.mouse = MyMouseCallback()
        self.mouse.Enabled = True
        
    def __exit__(self):
        self.mouse.Enabled = False
        del self.mouse
# ---------- end python ----------

# ---- group: Draw Mesh at Index
panel = Panel(python.Index)
item = ListItem(List=msphere, Index=python.Index, Wrap=True)
preview = CustomPreview(Geometry=item, Material=ColourSwatch(SwatchColor=RGB(255, 0, 0)))
