# Grasshopper definition 201019_DynamicallyVsStaticallyTyped_00.gh (Grasshopper 1.0.7)
# Copyright: Liljewall Arkitekter

python = GhPythonScript()  # -> out, a
# ---------- python: Python ----------
# Primitive types
foo = 42
bar = 3.14
myText = "Hello World"

# Data structures
myList = [1,2,3]
myDict = {"a":10,"b":20,"c":30}

# Reassign foo as double
foo = 42.0
# ---------- end python ----------
c_script = CSharpScript()  # -> out, A
# ---------- c_script: C# ----------
  
    // Primitive types
    int foo = 42;
    double bar = 3.14;
    string someText = "Hello World";
    
    // Data structures
    List<int> myList = new List<int>(){1,2,3};
    Dictionary<string,int> myDict = new Dictionary<string,int>(){{"a",10},{"b",20},{"c",30}};
    
    // Reassign foo as double (not possible because statically typed)
    // foo = 42.0;
# ---------- end c_script ----------
panel = Panel(c_script.out)
