# Grasshopper definition 210911_ExerciseSnippets_00.gh (Grasshopper 1.0.7)

# ---- group: Primitive Datatypes
# Python Basics 1
python = GhPythonScript()
# ---------- python: Python ----------
# Primitive data types
foo = 42
bar = 3.14
ham = "Hello World"
spam = True
eggs = None
# ---------- end python ----------

# ---- group: Multiline Comments
python_2 = GhPythonScript()
# ---------- python_2: Python ----------
"""
foo = 42
bar = 3.14
ham = "Hello World"
spam = True
eggs = None
"""
# ---------- end python_2 ----------

# ---- group: Naming conventions
python_3 = GhPythonScript()
# ---------- python_3: Python ----------
# Primitive data types
foo = 42
bar = 3.14
ham = "Hello World"
spam = True
eggs = None

# Naming conventions
foo_bar = 10
fooBar = 10
# ---------- end python_3 ----------

# ---- group: Variable Type Checking
python_4 = GhPythonScript()
# ---------- python_4: Python ----------
# Primitive data types
foo = 42
bar = 3.14
ham = "Hello World"
spam = True
eggs = None

# Check type of foo
print type(ham)
# ---------- end python_4 ----------

# ---- group: Get Variable Documentation
python_5 = GhPythonScript()
# ---------- python_5: Python ----------
# Primitive data types
foo = 42
bar = 3.14
ham = "Hello World"
spam = True
eggs = None

# Get documentation about ham
print help(type(ham))
# ---------- end python_5 ----------

# ---- group: Get Variable Properties And Methods
python_6 = GhPythonScript()
# ---------- python_6: Python ----------
# Primitive data types
foo = 42
bar = 3.14
ham = "Hello World"
spam = True
eggs = None

# Get properties and methods of ham
print dir(ham)
# ---------- end python_6 ----------

# ---- group: Get Help On Variable Property/Method
python_7 = GhPythonScript()
# ---------- python_7: Python ----------
# Primitive data types
foo = 42
bar = 3.14
ham = "Hello World"
spam = True
eggs = None

# Get help on ham method and try it
#print help(ham.istitle)
print ham.istitle()
# ---------- end python_7 ----------

# ---- group: Object Oriented Programming
python_8 = GhPythonScript()
# ---------- python_8: Python ----------
class Car(object):
       
    def __init__(self,brand,color):
        
        self.brand = brand
        self.color = color
        
    def paintCar(self,newColor):
        
        self.color += newColor

# Make car and paint it
c = Car("ford","red")
c.paintCar("green")
# ---------- end python_8 ----------

# ---- group: Arithmetic Operators
python_9 = GhPythonScript()
# ---------- python_9: Python ----------
# Addition
a = 42 + 3

# Subtraction
b = 42 - 3

# Multiplication
c = 42 * 3

# Division
d = 42 / 3

# Floor Division
d = 42 // 3

# Modulo
e = 42 % 3

# Power
f = 42 ** 3
# ---------- end python_9 ----------

# ---- group: String Operators
python_10 = GhPythonScript()
# ---------- python_10: Python ----------
# Concatenation
a = "foo" + "bar"

# Repetition
b = "foo " * 10

# Insertion
c = "Hello %s" % ("World")

# Line break (\ is escape symbol)
d = "Hello" + "\n" + "World"
# ---------- end python_10 ----------

# ---- group: Assignment Operators
python_11 = GhPythonScript()
# ---------- python_11: Python ----------
# Value
a = 42
b = "foo"

# Addition
a += 3

# Subtraction
a -= 3

# Multiplication
a *= 3

# Division
a /= 3

# Concatenation
b += "bar"

# Repetition
b *= 10
# ---------- end python_11 ----------

# ---- group: Comparison Operators
python_12 = GhPythonScript()
# ---------- python_12: Python ----------
# Equal
42 == 3
"foo" == "bar"

# Not equal
42 != 3
"foo" != "bar"

# Greater than
42 > 3

# Less than
42 < 3

# Greater than or equal to
42 >= 3

# Less than or equal to
42 <= 3
# ---------- end python_12 ----------

# ---- group: Conditional Statements 1
python_13 = GhPythonScript()
# ---------- python_13: Python ----------
# Assign values
a = 42
b = 3000

# Check if a is larger than b
if a > b:
    print "a is larger than b"
# ---------- end python_13 ----------

# ---- group: Conditional Statements 2
python_14 = GhPythonScript()
# ---------- python_14: Python ----------
# Assign values
a = 42
b = 3000

# Run different blocks based on condition
if a == b:
    print "a equals b"
elif a > b:
    print "a is larger than b"
else:
    print "a is smaller than b"
# ---------- end python_14 ----------

# ---- group: Conditional Statements 3
python_15 = GhPythonScript()
# ---------- python_15: Python ----------
# Assign values
a = "foo"
b = "bar"

# Check nested conditionals
if not a == b:
    print "a and b are not equal"
    if len(a) == len(b):
        print "but they have equal symbol count"
# ---------- end python_15 ----------

# ---- group: Conditional Statements 4
python_16 = GhPythonScript()
# ---------- python_16: Python ----------
# Assign values
a = "foo"
b = "bar"

# Chain multiple comparisons
if a != b and len(a) == len(b):
    print "a and b are not equal"
    print "but they have equal symbol count"
# ---------- end python_16 ----------

# ---- group: Data Structures 1
python_17 = GhPythonScript()
# ---------- python_17: Python ----------
# Make integer, string and mixed lists
integers = [1,2,3,4,5]
strings = ["ham","spam","eggs"]
mixed = [1,"ham",True,None]
# ---------- end python_17 ----------

# ---- group: Data Structures 2
python_18 = GhPythonScript()
# ---------- python_18: Python ----------
# Make integer, string and mixed lists
integers = [1,2,3,4,5]
strings = ["ham","spam","eggs"]
mixed = [1,"ham",True,None]

# Get list item by index
print integers[2]
print mixed[-1]

# Get sublist using slicing
print mixed[0:10]
print mixed[2:]

# Lists can be concatenated
allLists = integers + strings + mixed
print allLists
# ---------- end python_18 ----------

# ---- group: Data Structures 3
python_19 = GhPythonScript()
# ---------- python_19: Python ----------
# Make integer, string and mixed lists
integers = [1,2,3,4,5]
strings = ["ham","spam","eggs"]
mixed = [1,"ham",True,None]

# Edit list item
strings[0] = "beef"

# Add item to list end
strings.append("salt")

# Add list to list end
strings.extend(["jeff","britta","chang"])

# Get list length
print len(strings)
# ---------- end python_19 ----------

# ---- group: Data Structures 4
python_20 = GhPythonScript()
# ---------- python_20: Python ----------
# Make integer, string and mixed lists
integers = [1,2,3,4,5]
strings = ["ham","spam","eggs"]
mixed = [1,"ham",True,None]

# Check if item is in list
print "ham" in strings

# Make a nested list (e.g. a DataTree)
nested = [integers,strings,mixed]

# Insert item at index
strings.insert(2,"pepper")

# Remove and return item at index
print strings.pop(2)

# Etc.
# ---------- end python_20 ----------

# ---- group: Data Structures 5
python_21 = GhPythonScript()
# ---------- python_21: Python ----------
# Make an integer, a string, and a mixed tuple
integers = (1,2,3,4,5)
strings = ("ham","spam","eggs")
mixed = (1,"ham",True,None)

# Get tuple items by index/slicing
print integers[2]
print mixed[2:]

# You cannot edit tuples
#strings[0] = "beef"
#strings.append("salt")

# You can nest them though
nested = (integers,strings)

# When in doubt, just use lists
# ---------- end python_21 ----------

# ---- group: Data Structures 6
python_22 = GhPythonScript()
# ---------- python_22: Python ----------
# Make string set and check output
strings = {"ham","ham","spam","spam","eggs"}
print strings

# Can be used to remove duplicates in lists/tuples
foo = ["ham","ham","spam","spam","eggs"]
foo = list(set(foo))

# And mathematical set theory computations
a = {1,2,3,4,5}
b = {4,5,6,7,8}
print a.intersection(b)
print a.difference(b)
# ---------- end python_22 ----------

# ---- group: Data Structures 7
python_23 = GhPythonScript()
# ---------- python_23: Python ----------
# Make some dictionaries
foo = {"a":1,"b":2,"c":3}
bar = {"integers":(1,2,3),"meat":["ham","spam","eggs"]}

# Get value by key
print foo["a"]

# Get value item by key and index
print bar["meat"][2]

# Edit value by key and index
bar["meat"][2] = "bacon"

# Add new key/value pair
foo["d"] = 4
# ---------- end python_23 ----------

# ---- group: Importing Libraries 1
python_24 = GhPythonScript()
# ---------- python_24: Python ----------
# Standard Python
import re
import os
import sys
import copy
import random
import time
import datetime
import csv
import xml
import json
import pickle
import itertools
import collections
import statistics
import inspect

# .NET Framework
import System
# ---------- end python_24 ----------

# ---- group: Importing Libraries 2
python_25 = GhPythonScript()
# ---------- python_25: Python ----------
import math

# Constants
a = math.pi
b = math.e

# Angular conversion
c = math.radians(90)
d = math.degrees(c)

# Logarithmics/squares
e = math.log10(100)
f = math.sqrt(16)

# Trigonometry
g = math.sin(c)
h = math.cos(c)

# Etc.
# ---------- end python_25 ----------

# ---- group: Importing Libraries 3
# GHPython Basics 1
python_26 = GhPythonScript()
# ---------- python_26: Python ----------
# Import library
import Rhino

# Make a point at world origin
pt = Rhino.Geometry.Point3d(0,0,0)
# ---------- end python_26 ----------

# ---- group: Importing Libraries 4
python_27 = GhPythonScript()
# ---------- python_27: Python ----------
# Import library
import rhinoscriptsyntax

# Make a point at world origin
pt = rhinoscriptsyntax.AddPoint(0,0,0)
# ---------- end python_27 ----------

# ---- group: Importing Libraries 5
python_28 = GhPythonScript()
# ---------- python_28: Python ----------
# Import libraries
import rhinoscriptsyntax
import inspect

# Inspect source code of AddPoint function
print inspect.getsource(rhinoscriptsyntax.AddPoint)
# ---------- end python_28 ----------

# ---- group: Importing Libraries 6
python_29 = GhPythonScript()
# ---------- python_29: Python ----------
# Import library
import ghpythonlib

# Make a point at world origin
pt = ghpythonlib.components.ConstructPoint(0,0,0)
# ---------- end python_29 ----------

# ---- group: Importing Libraries 7
python_30 = GhPythonScript()
# ---------- python_30: Python ----------
# Import with aliases
import Rhino.Geometry as rg
import rhinoscriptsyntax as rs
import ghpythonlib.treehelpers as th
# ---------- end python_30 ----------

# ---- group: RhinoScriptSyntax
python_31 = GhPythonScript()
# ---------- python_31: Python ----------
# Import library
import rhinoscriptsyntax as rs

# Make point guid at world origin
ptGuid = rs.AddPoint(0,0,0)

# Get the underlying point
pt = rs.coerce3dpoint(ptGuid)

# Get point X property
print pt.X
# ---------- end python_31 ----------

# ---- group: RhinoCommon
python_32 = GhPythonScript()
# ---------- python_32: Python ----------
# Import library
import Rhino as rc

# Make point at world origin
pt = rc.Geometry.Point3d(0,0,0)

# Get point X property
print pt.X
# ---------- end python_32 ----------

# ---- group: Looping 1
# Python Basics 2
python_33 = GhPythonScript()
# ---------- python_33: Python ----------
# Initiate variable
foo = 0

# Loop while condition is true
while foo < 1000:
    
    # Increment variable and check result
    foo += 1
    print foo
# ---------- end python_33 ----------

# ---- group: Looping 2
python_34 = GhPythonScript()
# ---------- python_34: Python ----------
# Make list of stuff
stuff = ["ham","spam","eggs","foo","bar"]

# Iterate over stuff in list
for s in stuff:
    
    # Inspect item of stuff
    print s, type(s), len(s)
# ---------- end python_34 ----------

# ---- group: Looping 3
python_35 = GhPythonScript()
# ---------- python_35: Python ----------
print range(2,10,3)

# Iterate from zero to nine
for i in range(10):
    
    # Check current index
    print i
# ---------- end python_35 ----------

# ---- group: Looping 4
python_36 = GhPythonScript()
# ---------- python_36: Python ----------
# Iterate from ten to hundred at increments of five
for i in range(10,100,5):
    
    # Check current index
    print i
# ---------- end python_36 ----------

# ---- group: Looping 5
python_37 = GhPythonScript()
# ---------- python_37: Python ----------
# Make list of stuff
stuff = ["ham","spam","eggs","foo","bar"]

# Iterate over index and stuff in list
for i,s in enumerate(stuff):
    
    # Inspect index and item of stuff
    print i,s
# ---------- end python_37 ----------

# ---- group: Looping 6
python_38 = GhPythonScript()
# ---------- python_38: Python ----------
# Make lists
stuff = ["ham","spam","eggs","foo","bar"]
people = ["jeff","britta","troy","abed","annie"]

# Iterate over stuff and people by index/length
for i in range(len(stuff)):
    
    # Inspect stuff/person at index
    print stuff[i], people[i]
# ---------- end python_38 ----------

# ---- group: Looping 7
python_39 = GhPythonScript()
# ---------- python_39: Python ----------
# Make lists
stuff = ["ham","spam","eggs","foo","bar"]
people = ["jeff","britta","troy","abed"]

# Iterate over stuff/people using zip
for s,p in zip(stuff,people):
    
    # Inspect stuff/person
    print s,p
# ---------- end python_39 ----------

# ---- group: Looping 8
python_40 = GhPythonScript()
# ---------- python_40: Python ----------
# Make lists
stuff = ["ham","spam","eggs","foo","bar"]
people = ["jeff","britta","troy","abed","annie"]

# Iterate over stuff/people using zip
for s,p in zip(stuff,people):
    
    # Inspect stuff/person
    print s,p
    
    # Break loop
    if p == "britta":
        break
# ---------- end python_40 ----------

# ---- group: Sine Wave
# GHPython Basics 2
python_41 = GhPythonScript()  # -> pts, crv
# ---------- python_41: Python ----------
import math
import Rhino.Geometry as rg

# Make points
pts = []
for i in range(10):
    pt = rg.Point3d(i,math.sin(i),0)
    pts.append(pt)
    
# Make interpolated curve
crv = rg.NurbsCurve.CreateInterpolatedCurve(pts,3)
# ---------- end python_41 ----------

# ---- group: Functions
# Python Basics 3
python_42 = GhPythonScript()
# ---------- python_42: Python ----------
def fibSequence(n):
    
    """ Make fibonacci sequence using for loop """
    
    s = [0,1]
    for i in range(n-2):
        next = s[-1] + s[-2]
        s.append(next)
        
    return s

fib = fibSequence(10)

print fib
# ---------- end python_42 ----------

# ---- group: Empty Code
python_43 = GhPythonScript()
# ---------- python_43: Python ----------
# Some conditional statement
if 10 > 5:
    
    pass

def myFunction():
    
    """ An unfinished function """
    
    pass
# ---------- end python_43 ----------

# ---- group: Attractor System
attractors = Point([Point(9.800017611, 13.49044749, 2.245332475), Point(20.55577594, 33.76512424, 6.19604546), Point(40.79026104, 39.3036365, 5.873698725), Point(37.93180834, 9.380849257, 4.644754747)])
python_44 = GhPythonScript(UCount=Slider(50, range=0..100), VCount=Slider(50, range=0..100), Attractors=attractors)  # -> Surface, Contours; inputs UCount: Int32, VCount: Int32, Attractors: list of Point3d
# ---------- python_44: Python ----------
import Rhino as rc

# Make point grid
grid = []
for i in range(UCount):
    for j in range(VCount):
        grid.append(rc.Geometry.Point3d(i,j,0))
        
# Move grid points along Z by nearest attractor point
attractors = rc.Collections.Point3dList(Attractors)
for pt in grid:
    clID = attractors.ClosestIndex(pt)
    d = attractors[clID].DistanceTo(pt)
    pt.Z = d
    
# Make surface through grid points
Surface = rc.Geometry.NurbsSurface.CreateThroughPoints(grid,UCount,VCount,3,3,False,False)

# Cast and contour surface (expensive!!)
Contours = rc.Geometry.Brep.CreateContourCurves(Surface.ToBrep(),rc.Geometry.Point3d(0,0,0),rc.Geometry.Point3d(0,0,25),1.0)
# ---------- end python_44 ----------

# ---- group: Curvature Graph
curve = Curve(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)
python_45 = GhPythonScript(Curve=curve, Count=Slider(759, range=0..1000), Multiplier=Slider(6.47, range=0..100))  # -> Mesh; inputs Curve: Curve, Count: Int32
# ---------- python_45: Python ----------
import Rhino as rc

# Get curvature data along curve
points,vectors = [],[]
for t in Curve.DivideByCount(Count,True):
    points.append(Curve.PointAt(t))
    vectors.append(Curve.CurvatureAt(t))

# Make curvature graph mesh
Mesh = rc.Geometry.Mesh()

# Add mesh vertices
for pt,vec in zip(points,vectors):
    Mesh.Vertices.Add(pt)
    Mesh.Vertices.Add(pt + -vec*Multiplier)

# Add mesh faces
for i in range(0,Count*2-1,2):
    Mesh.Faces.AddFace(i,i+1,i+3,i+2)

# Get minimum and maximum curvature values
curvatures = [vec.Length for vec in vectors]
minC,maxC = min(curvatures),max(curvatures)

# Color mesh vertices
for i,c in enumerate(curvatures):
    
    # Remap curvature value to rainbow color
    hue = (c-minC)/(maxC-minC)*0.65
    hsv = rc.Display.ColorHSV(hue,1.0,1.0) 
    
    # Set mesh vertex colors
    Mesh.VertexColors.SetColor(i*2,hsv)
    Mesh.VertexColors.SetColor(i*2+1,hsv)
# ---------- end python_45 ----------

# ---- group: Rainbow Gradient
python_46 = GhPythonScript()  # -> Colors
# ---------- python_46: Python ----------
import Rhino as rc

def valuesToRainbow(values):
    
    """ Make a list of colors along hue spectrum,
    meaning that 0.0 = red and 0.7 = blue """
    
    colors = []
    for v in values:
        hsv = rc.Display.ColorHSV(v,1.0,1.0)
        rgb = hsv.ToArgbColor()
        colors.append(rgb)
        
    return colors

# Some remapped analysis data (i.e. to 0.0-0.7 domain)
someData = (0.0,0.1,0.2,0.3,0.4,0.5,0.6,0.7)

# Make visualisation colors
Colors = valuesToRainbow(someData)
# ---------- end python_46 ----------
legend = Legend(Colour=python_46, Tags=" ", LegendType=102)

# ---- group: Random Walk
# Rhinocommon Basics 1
number_slider = Slider(0, range=0..100)
python_47 = GhPythonScript(Seed=number_slider, Steps=Slider(100, range=0..100))  # -> Walk; inputs Seed: Int32, Steps: Int32
# ---------- python_47: Python ----------
import Rhino as rc
import random as rd

# Make empty polyline and add start point
pl = rc.Geometry.Polyline()
pl.Add(0,0,0)

# Set random seed
rd.seed(Seed)

# Perform random walk
for i in range(Steps):
    
    # Make random vector
    x = rd.uniform(-1,1)
    y = rd.uniform(-1,1)
    z = rd.uniform(-1,1)
    rdVec = rc.Geometry.Vector3d(x,y,z)
    
    # Get/move/add polyline point by random vector
    newPt = pl.Last + rdVec
    pl.Add(newPt)
    
# Cast and output polyline to Grasshopper
Walk = pl.ToNurbsCurve()
# ---------- end python_47 ----------

# ---- group: Best Practice 1
# GHPython Basics 3
number_slider_2 = Slider(500, range=0..1000)
curve_2 = Curve(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)
acc = AnalyseCurveCurvature(Curve=curve_2, Count=number_slider_2, Multiplier=Slider(5, range=0..100))  # -> Mesh; inputs Curve: Curve, Count: Int32
# ---------- acc: Python ----------
"""
Visualise Curve curvature as rainbow colored mesh graph.
    Inputs:
        Curve: The curve to analyse {item,curve}
        Count: Amount of samples along Curve {item,int}
        Multiplier: Multiply curvature amount {item,float}
    Outputs:
        Mesh: The colored mesh graph {item,mesh}
    Remarks:
        Author: Anders Holden Deleuran (BIG IDEAS)
        Rhino: 7.10.21236.11001
        Version: 210907
"""

ghenv.Component.Name = "AnalyseCurveCurvature"
ghenv.Component.NickName = "ACC"

import Rhino as rc

def getCurveCurvature(curve,count):
    
    """ Get curvature data along curve """
    
    # Make empty lists
    points,vectors,values = [],[],[]
    
    # Iterate curve parameters
    for t in curve.DivideByCount(count,True):
        
        # Get data
        pt = curve.PointAt(t)
        vec = curve.CurvatureAt(t)
        val = vec.Length
        
        # Add data
        points.append(pt)
        vectors.append(vec)
        values.append(val)
        
    return points,vectors,values    

def makeRainBowGraph(points,vectors,values,multiplier):
    
    """ Make rainbow colored graph along points by vectors/values """
    
    # Make empty mesh
    m = rc.Geometry.Mesh()
    
    # Add mesh vertices
    for pt,vec in zip(points,vectors):
        m.Vertices.Add(pt)
        m.Vertices.Add(pt + -vec*multiplier)
        
    # Add mesh faces
    for i in range(0,Count*2-1,2):
        m.Faces.AddFace(i,i+1,i+3,i+2)
        
    # Get minimum and maximum values
    minC,maxC = min(values),max(values)
    
    # Color mesh vertices
    for i,c in enumerate(values):
        
        # Remap value to rainbow color
        hue = (c-minC)/(maxC-minC)*0.65
        hsv = rc.Display.ColorHSV(hue,1.0,1.0) 
        
        # Set mesh vertex colors
        m.VertexColors.SetColor(i*2,hsv)
        m.VertexColors.SetColor(i*2+1,hsv)
        
    return m

# Empty outputs
Mesh = []

print Curve

# Check inputs
if Curve and Count and Multiplier:
    
    # Call functions
    points,vectors,values = getCurveCurvature(Curve,Count)
    meshGraph = makeRainBowGraph(points,vectors,values,Multiplier)
    
    # Output to Grasshopper
    Mesh = meshGraph
# ---------- end acc ----------

# ---- group: Best Practice 2
python_48 = GhPythonScript()
# ---------- python_48: Python ----------
import time

class Timer(object):
    
    """ A simple profiler """
    
    def start(self):
        self.startTime = time.time()
        
    def stop(self):
        elapsedSeconds = time.time() - self.startTime
        elapsedMilliseconds = elapsedSeconds*1000
        print str(round(elapsedMilliseconds,3)) + " ms"
        return elapsedMilliseconds

# Make and start timer
pf = Timer()
pf.start()

# Do something heavy
foo = 0
for i in range(100000):
    foo += i

# Stop timer
pf.stop()
# ---------- end python_48 ----------

# ---- group: Dynamic Random Walk
run = BooleanToggle(False)
python_49 = GhPythonScript(Run=run, Seed=Slider(0, range=0..1000), Steps=Slider(1000, range=0..100000))  # -> Last; inputs Seed: Int32, Steps: Int32
# ---------- python_49: Python ----------
import Rhino as rc
import random as rd
import Grasshopper as gh

def updateComponent(interval):
    
    """ Updates this component similar to using a Grasshopper timer """
    
    # Define callback action
    def callBack(e):
        ghenv.Component.ExpireSolution(False)
        
    # Schedule this component to expire
    ghenv.Component.OnPingDocument().ScheduleSolution(interval,
    gh.Kernel.GH_Document.GH_ScheduleDelegate(callBack))

# Make persistent display
if "display" not in globals():
    display = rc.Display.CustomDisplay(True)

# Reset state
if not Run:
    
    # Clear display
    display.Clear()
    
    # Make empty polyline and add start point
    walk = rc.Geometry.Polyline()
    walk.Add(0,0,0)
    
    # Set random seed
    rd.seed(Seed)
    
    # Make iteration counter
    i = 0
    
    # Set message
    ghenv.Component.Message = "System Reset"

# Run state
else:
    
    # Make random vector
    x = rd.uniform(-1,1)
    y = rd.uniform(-1,1)
    z = rd.uniform(-1,1)
    rdVec = rc.Geometry.Vector3d(x,y,z)
    
    # Get/move/add polyline point by random vector
    newPt = walk.Last + rdVec
    walk.Add(newPt)
    
    # Make color
    c = rc.Display.ColorHSV((i+1)/Steps,1.0,1.0).ToArgbColor()
    
    # Draw stuff
    l = rc.Geometry.Line(walk[walk.Count-2],walk.Last)
    display.AddLine(l,c,2)
    
    # Increment count and component
    if i < Steps:
        i += 1
        updateComponent(1)
        
    # Output to Grasshopper
    Last = l
    ghenv.Component.Message = "Iterations = " + str(i)
# ---------- end python_49 ----------

# ---- group: Interfacing Rhino 3
python_50 = GhPythonScript()  # -> Geometry
# ---------- python_50: Python ----------
import Rhino as rc
import scriptcontext as sc
import rhinoscriptsyntax as rs

# Set context to Rhino document
sc.doc = rc.RhinoDoc.ActiveDoc

# Get mixed geometry from Rhino document layer
Geometry = []
for guid in rs.ObjectsByLayer("Default"):
    geo = rs.coercegeometry(guid)
    Geometry.append(geo)

# Set context back to Grasshopper
sc.doc = ghdoc
# ---------- end python_50 ----------

# ---- group: Interfacing Rhino 2
python_51 = GhPythonScript()  # -> Points
# ---------- python_51: Python ----------
import Rhino as rc
import scriptcontext as sc
import rhinoscriptsyntax as rs

# Set context to Rhino document
sc.doc = rc.RhinoDoc.ActiveDoc

# Get points from Rhino document layer
Points = []
for guid in rs.ObjectsByLayer("Default"):
    pt = rs.coerce3dpoint(guid)
    Points.append(pt)

# Set context back to Grasshopper
sc.doc = ghdoc
# ---------- end python_51 ----------

# ---- group: Interfacing Rhino 1
# GHPython Advanced
python_52 = GhPythonScript()  # disabled
# ---------- python_52: Python ----------
import Rhino as rc
import scriptcontext as sc
import rhinoscriptsyntax as rs

# Set context to Rhino document
sc.doc = rc.RhinoDoc.ActiveDoc

# Add point to Rhino document
rs.AddPoint(0,0,0)

# Set context back to Grasshopper
sc.doc = ghdoc
# ---------- end python_52 ----------

# ---- group: Interfacing Rhino 2
python_53 = GhPythonScript()  # disabled
# ---------- python_53: Python ----------
import Rhino as rc
import scriptcontext as sc
import rhinoscriptsyntax as rs

# Set context to Rhino document/disable redraw
sc.doc = rc.RhinoDoc.ActiveDoc
rs.EnableRedraw(False)

# Add many points to Rhino document
for i in range(100):
    rs.AddPoint(i,i,i)

# Set context back to Grasshopper
rs.EnableRedraw(True)
sc.doc = ghdoc
# ---------- end python_53 ----------

# ---- group: Dynamic Random Walk / Draw Current
D = D(line=python_49)

# ==== cluster D
line = ClusterInput()

# ---- group: Draw Current Vector
line_2 = Line(line)
end = EndPoints(Curve=line_2)  # -> Start, End
vdisex = VectorDisplayEx(Point=end.Start, Vector=line_2, Colour=RGB(0, 0, 0), Width=4)
