# Grasshopper definition 240702_MeshZebraAnalysis_00.gh (Grasshopper 1.0.7)

colour_swatch = ColourSwatch(SwatchColor=RGB(76, 76, 76))
mesh = Mesh(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)
mza = MeshZebraAnalysis(
    Meshes=mesh,
    BackColor=ColourSwatch(SwatchColor=RGB(255, 255, 255)),
    StripeColor=ColourSwatch(SwatchColor=RGB(255, 0, 0)),
    Thickness=Slider(2, range=0..6))  # inputs Meshes: list
# ---------- mza: Python ----------
"""
Implementation of the Rhino Zebra analysis mode for meshes.
    Inputs:
        Meshes: {list,mesh}
        BackColor: Background color {item,color}
        StripeColor: Color of zebra stripes {item,color}
        EdgeColor: Color of mesh edges {item,color,optional}
        Thickness: Thickness of zebra stripes (0:fat, 6:thin) {item,float}
    Outputs:
    Remarks:
        Author: Anders Holden Deleuran (BIG CPH)
        Rhino: 7.37.24107.15001
        Version: 240702
"""

ghenv.Component.Name = "MeshZebraAnalysis"
ghenv.Component.NickName = "MZA"


import Rhino as rc
import GhPython.Assemblies.ExecutingComponent as component

class MyComponent(component):
    
    def RunScript(self,Meshes,BackColor,StripeColor,EdgeColor,Thickness):
            
            # Assign input parameters
            self.meshes = Meshes
            self.edgeColor = EdgeColor
            self.backColor = BackColor
            
            # Set global stripe properties
            rc.ApplicationSettings.ZebraAnalysisSettings.StripeColor = StripeColor
            rc.ApplicationSettings.ZebraAnalysisSettings.StripeThickness = Thickness
            
    def DrawViewportMeshes(self,arg):
        for m in self.meshes:
            if m:
                arg.Display.DrawZebraPreview(m,self.backColor)
                
    def DrawViewportWires(self,arg):
        if self.edgeColor:
            for m in self.meshes:
                if m:
                    arg.Display.DrawMeshWires(m,self.edgeColor,1)
# ---------- end mza ----------
